# Grasshopper definition debug.gh (Grasshopper 0.9.76)
# plug-ins: Radical

slider_4 = Slider(0.37, range=0..1)
slider_3 = Slider(0.164, range=0..1)
slider_2 = Slider(0.465, range=0..1)
slider_1 = Slider(0.883, range=0..1)
graph = GraphMapper(
    slider_1,
    x0=0,
    x1=1,
    y0=0,
    y1=1,
    container_name="Sinc",
    Equation_X0=0.4273509085,
    Equation_X1=0.7434785366,
    Equation_Y0=0.9422633648,
    Equation_Y1=0.7391304374)
graph_2 = GraphMapper(
    slider_4,
    x0=0,
    x1=1,
    y0=0,
    y1=1,
    container_name="Sinc",
    Equation_X0=0.1579711437,
    Equation_X1=0.7434785366,
    Equation_Y0=0.3072463274,
    Equation_Y1=0.7391304374)
graph_3 = GraphMapper(
    slider_3,
    x0=0,
    x1=1,
    y0=0,
    y1=1,
    container_name="Sinc",
    Equation_X0=0.5805619955,
    Equation_X1=0.7434785366,
    Equation_Y0=0.7237856388,
    Equation_Y1=0.7391304374)
graph_4 = GraphMapper(
    slider_2,
    x0=0,
    x1=1,
    y0=0,
    y1=1,
    container_name="Sinc",
    Equation_X0=0.2681159377,
    Equation_X1=0.7434785366,
    Equation_Y0=0.4202898741,
    Equation_Y1=0.7391304374)
srf = Surface(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)
crv = Curve(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)
mm = MassMultiplication(Input=[graph_2, graph_3, graph_4, graph])  # -> Result, PartialResults
area = Area(Geometry=srf)  # -> Area, Centroid
len = Length(Curve=crv)
galapagos = Galapagos(gene=[slider_2, slider_1, slider_3, slider_4])
rad = Radical(
    Objective=len,
    Constraints=[mm.Result, area.Area],
    NumericalVariables=[slider_3, slider_4, slider_2, slider_1],
    SrfVar=srf,
    CrvVar=crv)
number_slider = Slider(1, range=0..1)
number_slider_2 = Slider(1, range=0..1)
number_slider_3 = Slider(1, range=0..1)
number_slider_4 = Slider(1, range=0..1)
number_slider_5 = Slider(1, range=0..1)
number_slider_6 = Slider(1, range=0..1)
number_slider_7 = Slider(1, range=0..1)
number_slider_8 = Slider(1, range=0..1)
number_slider_9 = Slider(1, range=0..1)
number_slider_10 = Slider(1, range=0..1)
number_slider_11 = Slider(1, range=0..1)
number_slider_12 = Slider(1, range=0..1)
number_slider_13 = Slider(1, range=0..1)
number_slider_14 = Slider(1, range=0..1)
number_slider_15 = Slider(1, range=0..1)
number_slider_16 = Slider(1, range=0..1)
number_slider_17 = Slider(1, range=0..1)
number_slider_18 = Slider(1, range=0..1)
number_slider_19 = Slider(1, range=0..1)
number_slider_20 = Slider(1, range=0..1)
number_slider_21 = Slider(1, range=0..1)
number_slider_22 = Slider(1, range=0..1)
number_slider_23 = Slider(1, range=0..1)
number_slider_24 = Slider(1, range=0..1)
